# Grasshopper definition hops_text_test.gh (Grasshopper 1.0.8)

a = GetInteger("1", AtLeast=1, AtMost=1, Maximum=2147483647, Minimum=-2147483648, TreeAccess=False)
b = GetInteger("2", AtLeast=1, AtMost=1, Maximum=2147483647, Minimum=-2147483648, TreeAccess=False)
integer = Integer(a)
integer_2 = Integer(b)
addition = Addition(A=integer, B=integer_2)
multiplication = Multiplication(A=addition, B=integer_2)
integer_3 = Integer(multiplication)
context_print = ContextPrint(Result=integer_3)
